test file "controllerTest"

suite "TestSuite"

  case "Scenario5" [simulation]
    description: Scenario 5:
      State = regenerative braking
      AccPedal = 0
      BrakePedal = pulse signal of amplitude 0.5, width 0.5 and period 10 seconds.
      SOC = 50%
    model controllerModel
    input "controllerInputs5.mat", mapped to state, AccPedal, BrakePedal, SOC (active)

  case "Scenario6" [simulation]
    description: Scenario 6:
      State = regenerative braking
      AccPedal = 0
      BrakePedal = pulse signal of amplitude 0.1, width 0.5 and period 10 seconds.
      SOC = 50%
    model controllerModel
    input "controllerInputs6.mat", mapped to state, AccPedal, BrakePedal, SOC (active)

  case "Scenario7" [simulation]
    description: Scenario 7:
      State = regenerative braking
      AccPedal = 0
      BrakePedal = pulse signal of amplitude 0.9, width 0.5 and period 10 seconds.
      SOC = 100%
    model controllerModel
    input "controllerInputs7.mat", mapped to state, AccPedal, BrakePedal, SOC (active)

  case "Scenario8" [simulation]
    description: Scenario 8:
      State = regenerative braking
      AccPedal = 0
      BrakePedal = exponential growth and decay over time
      SOC = 50%
    model controllerModel
    input "controllerInputs8.mat", mapped to state, AccPedal, BrakePedal, SOC (active)

  case "Baseline_trial" [baseline]
    description: Trial
    model controllerModel
    input "controllerInputs4.mat", mapped to state, AccPedal, BrakePedal, SOC (active)
    logged signals "Signal Set 1": IC_MGU
    baseline "IC_MGU.mat"
      IC_MGU

suite "No Charge"

  case "Scenario 10" [baseline]
    description: State = no charge
      AccPedal = exponential growth and decay over time
      BrakePedal = 0
      SOC = between 0 and 0.1
    model controllerModel
    input "controllerInputs10.mat", mapped to state, AccPedal, BrakePedal, SOC (active)
    logged signals "Signal Set 1": ICreq
    assessment "Assessment1": At any point of time, ICreq <= AccPedal | ICreq <= 1 must be true
      ICreq: signal controllerModel/TrqDemController, port 1
      AccPedal: signal controllerModel/AccPedal, port 1

suite "Dead"
  description: Dead case suite of tests

  case "Scenario9" [baseline]
    description: Scenario 9:
      State = dead
      AccPedal = exp growth and decay
      BrakePedal = 0
      SOC = from 0.1 to 0
    model controllerModel
    input "controllerInputs9.mat", mapped to state, AccPedal, BrakePedal, SOC (active)
    logged signals "Signal Set 1": ICreq, MGUreq, IC_MGU
    baseline "Dead_baseline.mat": abs tol 1e-06, rel tol 1e-06
      IC_MGU
      ICreq
      MGUreq
      ICreq
      IC
      MGU
      MGUreq
      MGUbrk
      FrontBrake
      MGUbrk+Brake

suite "Combined"
  description: Combined case suite of tests

  case "Scenario4" [simulation]
    description: Scenario 4:
      State = combined
      AccPedal = exponential growth and decay over time
      BrakePedal = 0
      SOC = 50%
    model controllerModel
    input "controllerInputs4.mat", mapped to state, AccPedal, BrakePedal, SOC (active)

  case "Scenario 1" [baseline]
    description: Scenario 1:
      State = combined
      AccPedal = pulse signal of amplitude 0.5, width 0.5 and period 10 seconds
      BrakePedal = 0
      SOC = 50%
    model controllerModel
    input "controllerInputs1.mat", mapped to state, AccPedal, BrakePedal, SOC (active)
    logged signals "Signal Set 1": IC_MGU
    baseline "Combined_Baseline1.mat"
      IC_MGU: abs tol 0.05, rel tol 0.001

  case "Scenario2" [baseline]
    description: Scenario 2:
      State = combined
      AccPedal = pulse signal of amplitude 0.1, width 0.5 and period 10 seconds
      BrakePedal = 0
      SOC = 50%
    model controllerModel
    input "controllerInputs2.mat", mapped to state, AccPedal, BrakePedal, SOC (active)
    logged signals "Signal Set 1": IC_MGU
    baseline "Combined_Baseline2.mat": abs tol 0.03
      IC_MGU

  case "Scenario3" [baseline]
    description: Scenario 3:
      State = combined
      AccPedal = pulse signal of amplitude 0.9, width 0.5 and period 10 seconds
      BrakePedal = 0
      SOC = 50%
    model controllerModel
    input "controllerInputs3.mat", mapped to state, AccPedal, BrakePedal, SOC (active)
    logged signals "Signal Set 1": IC_MGU
    baseline "Combined_Baseline3.mat": leading tol 1
      IC_MGU